# Grasshopper definition WoodColumnCrossSection.gh (Grasshopper 0.9.76)
# plug-ins: Python Interpreter

width_mm = Panel("""50
38
50
50
75
50
50
63
50
50
100
50
75
75
75
125
75
100
150
100
175
200""")
data = Data(width_mm)
panel = Panel("Savskåret træ")
height_mm = Panel("""50
73
75
100
75
125
150
125
175
200
100
225
150
175
200
125
225
200
150
225
175
200""")
data_2 = Data(height_mm)
area_10_3_mm2 = Panel("""2.5
2.77
3.75
5
5.62
6.25
7.5
7.87
8.75
10
10
11.25
11.25
13.15
15
15.65
16.9
20
22.5
22.5
30.6
40""")
data_3 = Data(area_10_3_mm2)
wy_10_3_mm_3 = Panel("""20.8
33.8
46.9
83.3
70.3
130
187.5
164
255
333
166.5
422
281
383
500
326
633
667
563
844
893
1335""")
data_4 = Data(wy_10_3_mm_3)
wz_10_3_mm_3 = Panel("""20.8
17.57
31.3
41.7
70.3
52.1
62.5
82.7
72.9
83.3
166.5
93.8
140.5
164
187.5
326
211
333
563
375
893
1335""")
data_5 = Data(wz_10_3_mm_3)
iy_10_6_mm_4 = Panel("""0.521
1.232
1.760
4.17
2.64
8.14
14.05
10.25
22.3
33.3
8.33
47.5
21.1
33.5
50
20.3
71.2
66.7
42.2
94.9
78.2
133.5""")
data_6 = Data(iy_10_6_mm_4)
iz_10_6_mm_4 = Panel("""0.521
0.334
0.781
1.04
2.64
1.3
1.56
2.6
1.825
2.08
8.33
2.34
5.27
6.15
7.03
20.3
7.91
16.65
42.2
18.75
78.2
133.5""")
data_7 = Data(iz_10_6_mm_4)
entwine = Entwine(
    Branch00=data,
    Branch01=data_2,
    Branch02=data_3,
    Branch03=data_4,
    Branch04=data_5,
    Branch05=data_6,
    Branch06=data_7,
    FlattenInputs=True)
data_8 = Data(entwine)

# ---- group: Support conditions column
list = ValueList({"Simply supported both ends": 1, "One end fixed and one end not supported": 2, "One end fixed and one end simply supported": 0.699, "Both ends fixed": 1/2}, selected="One end fixed and one end not supported")

# ----
# Reduced Cross Section Method
number_slider = Slider(14, range=0..100)

# ---- group: Wood species charring rate
list_2 = ValueList({"Conifer with p > 290 kg/m3": 0.8, "Laminated wood with p > 290 kg/m3": 0.7, "Hardwood with p > 450 kg/m3": 0.55}, selected="Conifer with p > 290 kg/m3")

# ---- group: Strength class wood
strength_class_for_wood = ValueList({"C30": 30, "C24": 24, "C18": 18, "C14": 14, "GL32": 32, "Gl28": 28, "GL24": 24}, selected="C24")

# ----
# "Calculation of minimum required cross section of wooden columns"
# 
# "2017"
# 
# Created by Mikkel Dohm Andersen
load_in_n = Slider(525, range=0..1000)
panel_2 = Panel("Charring Layer")
time = Data(Slider(100, range=0..100))
pt = ConstructPoint(XCoordinate=0, YCoordinate=0, ZCoordinate=0)
pt_2 = ConstructPoint(XCoordinate=0, YCoordinate=0, ZCoordinate=Slider(3000, range=0..10000))
time_of_exposure = Data(number_slider)
charring_rate = Data(list_2)
abs = Absolute(Value=time)
ln = Line(StartPoint=pt, EndPoint=pt_2)
time_of_exposure_2 = Data(time_of_exposure)
pyrolysis_zone = PythonScript(t=abs)  # -> out, dpy
# ---------- pyrolysis_zone: Python ----------
if t<20: 
    dpy = 7/20*t 
else:
    dpy = 7

print(dpy)
# ---------- end pyrolysis_zone ----------
charring_rate_2 = Data(charring_rate)
expression = Expression(B=charring_rate_2, t=time_of_exposure_2, Expression="B*t")

# ---- group: Calculate required moment of inertia python
calculate_required_moment_of_inertia = PythonScript(Ncr=load_in_n, E=strength_class_for_wood, SupCon=list, CL=ln)  # -> out, I
# ---------- calculate_required_moment_of_inertia: Python ----------
import math as m
import rhinoscriptsyntax as rs

ls = rs.CurveLength(CL)*SupCon
I = (m.pow(ls,2)*Ncr)/(m.pow(m.pi,2)*E)
print(I)
# ---------- end calculate_required_moment_of_inertia ----------

# ----
pyrolysis_zone_2 = Data(pyrolysis_zone.dpy)

# ---- group: Calculate required moment of inertia expression
beregning_af_inertimoment_expression = BeregningAfInertimomentExpression(load=load_in_n, strength_class_wood=strength_class_for_wood, support_conditions=list, centerline_for_column=ln)  # disabled

# ----
charring_layer = Data(expression)
panel_3 = Panel(calculate_required_moment_of_inertia.I)
addition = Addition(A=charring_layer, B=pyrolysis_zone_2)

# ---- group: Calculate required moment of inertia components
beregning_af_inertimoment_med_komponente = BeregningAfInertimomentMedKomponenter()  # "Beregning af inertimoment med komponenter"; disabled

# ----
carring_layer_pyrolysis_zone = Data(addition)
fire_exposed_sides_of_cross_section = ValueList({"Width": 1, "Width + 2*Height": 2, "All": 3}, selected="All")
requried_moment_of_inertia = Data(calculate_required_moment_of_inertia.I)
type_of_wood = Data(Tree({0;0}: ["50", "38", "50", "50", "75", "50", "50", "63", "50", "50", "100", "50", "75", "75", "75", "125", "75", "100", "150", "100", "175", "200"], {0;1}: ["50", "73", "75", "100", "75", "125", "150", "125", "175", "200", "100", "225", "150", "175", "200", "125", "225", "200", "150", "225", "175", "200"], {0;2}: ["2.5", "2.77", "3.75", "5", "5.62", "6.25", "7.5", "7.87", "8.75", "10", "10", "11.25", "11.25", "13.15", "15", "15.65", "16.9", "20", "22.5", "22.5", "30.6", "40"], {0;3}: ["20.8", "33.8", "46.9", "83.3", "70.3", "130", "187.5", "164", "255", "333", "166.5", "422", "281", "383", "500", "326", "633", "667", "563", "844", "893", "1335"], {0;4}: ["20.8", "17.57", "31.3", "41.7", "70.3", "52.1", "62.5", "82.7", "72.9", "83.3", "166.5", "93.8", "140.5", "164", "187.5", "326", "211", "333", "563", "375", "893", "1335"], {0;5}: ["0.521", "1.232", "1.760", "4.17", "2.64", "8.14", "14.05", "10.25", "22.3", "33.3", "8.33", "47.5", "21.1", "33.5", "50", "20.3", "71.2", "66.7", "42.2", "94.9", "78.2", "133.5"], {0;6}: ["0.521", "0.334", "0.781", "1.04", "2.64", "1.3", "1.56", "2.6", "1.825", "2.08", "8.33", "2.34", "5.27", "6.15", "7.03", "20.3", "7.91", "16.65", "42.2", "18.75", "78.2", "133.5"]))

panel_4 = Panel("Exposed sides")

# ---- group: Smallest profile with enough capacity
requried_moment_of_inertia_2 = Data(requried_moment_of_inertia)
type_of_wood_2 = Data(type_of_wood)
flip = FlipMatrix(Data=type_of_wood_2)
item = ListItem(List=flip, Index=0, Wrap=True)  # -> flatten(Item), flatten(Item1), flatten(Item2), flatten(Item3), flatten(Item4), flatten(Item5), flatten(Item6)
wy = Data(item.Item3)
wz = Data(item.Item4)
iy = Data(item.Item5)
width = Data(item.Item)
area = Data(item.Item2)
iz = Data(item.Item6)
height = Data(item.Item1)
iy_2 = Data(iy)
iz_2 = Data(iz)
python = PythonScript(I=requried_moment_of_inertia_2, Iy=iy_2, Iz=iz_2)  # -> out, PatternY, PatternZ; inputs Iy: list, Iz: list
# ---------- python: Python ----------
""" Returns member boolean statement indicating moments of inertia larger than needed

    Args:
        I: Moment of inertia needed
        Iy: Moment of inertia y-axiz
        Iz: Moment of inertia z-axiz
    Returns:
        PatternY: Boolean statement for capacity > needed for y axis
        PatternZ: Boolean statement for capacity > needed for z axis
"""
Y=[]
Z=[]

# Muliplying the list values to match input for Iy
for i in Iy:
    Y.append(i*10**6)
for i in Iz:
    Z.append(i*10**6)
#print (y)

#Empty list for the new values
PatternY=[]
PatternZ=[]
#Creating boolean statement for capacity > needed
for i in Y:
    PatternY.append(i>I)
#print(PatternY)
for i in Z:
    PatternZ.append(i>I)
#print(PatternZ)
str(PatternY)
str(PatternZ)
# ---------- end python ----------
python_2 = PythonScript(x=python.PatternY, y=python.PatternZ)  # -> out, True, False; inputs x: list, y: list
# ---------- python_2: Python ----------
""" Combines two equal length lists of boolean statements
    to one, either dominated by true or false values
"""
T = []
F = []
for i in x:
    if i == 'True':
        T.append('True')
        F.append('True')
    else:
        T.append('False')
        F.append('False')

for i in range(len(y)):
    if y[i] == 'True':
        T[i]= 'True'

for i in range(len(y)):
    if y[i] == 'False':
        F[i]= 'False'

True=T
False=F
# ---------- end python_2 ----------
cull = CullPattern(List=area, CullPattern=python_2.True)
bnd = Bounds(Numbers=cull)
num = Number(area)
dedomain = DeconstructDomain(Domain=bnd)  # -> Start, End
mindex = MemberIndex(Set=num, Member=dedomain.Start)  # -> Index, Count
num_2 = Number(width)
num_3 = Number(height)

# ----
panel_5 = Panel(python_2.True)
num_4 = Number(num)
bnd_2 = Bounds(Numbers=mindex.Index)
bnd_3 = Bounds(Numbers=cull)
dedomain_2 = DeconstructDomain(Domain=bnd_2)  # -> Start, End
dedomain_3 = DeconstructDomain(Domain=bnd_3)  # -> Start, End
item_2 = ListItem(List=num_4, Index=dedomain_2.Start, Wrap=True)

# ---- group: Smallest profile with enough capacity (continued)
item_3 = ListItem(List=num_3, Index=dedomain_2.Start, Wrap=True)
item_4 = ListItem(List=num_2, Index=dedomain_2.Start, Wrap=True)
width_2 = Data(item_4)
height_2 = Data(item_3)

# ----
width_3 = Data(width_2)
width_4 = Data(width_3)
panel_6 = Panel(width_4)
height_3 = Data(height_2)
height_4 = Data(height_3)
panel_7 = Panel(height_4)

python_3 = PythonScript(W=width_4, H=height_4, d=carring_layer_pyrolysis_zone, z=fire_exposed_sides_of_cross_section)  # -> out, Width, Height
# ---------- python_3: Python ----------
if z==1:
    Width=W-d
    Height=H
elif z==2:
    Width=W-d
    Height=H-2*d
elif z==3:
    Width=W-2*d
    Height=H-2*d
# ---------- end python_3 ----------

panel_8 = Panel(python_3.Width)
panel_9 = Panel(python_3.Height)
iy_3 = Expression(W=python_3.Width, H=python_3.Height, Expression="1/12*W*H^3")

# ---- group: Iz
iy_4 = Expression(W=python_3.Width, H=python_3.Height, Expression="1/12*H*W^3")

# ----
python_4 = PythonScript(W=python_3.Width, H=python_3.Height)  # -> out, Iy, Iz; inputs W: list, H: list
# ---------- python_4: Python ----------
for i in len(range(W)):
Iy=1/12*H(i)*W(i)^3
Iz=1/12*W(i)*H(i)^3
# ---------- end python_4 ----------
panel_10 = Panel(iy_3)
python_5 = PythonScript(I=requried_moment_of_inertia_2, Iy=iy_3, Iz=iy_4)  # -> out, PatternY, PatternZ; inputs Iy: list, Iz: list; same code as python

# ==== cluster BeregningAfInertimomentExpression
centerline_for_column = ClusterInput()  # Input center line for column
strength_class_wood = ClusterInput()  # Strength class of wood for column
line = Line(centerline_for_column)
support_conditions = ClusterInput()  # Insert support conditions
load = ClusterInput()  # Critical vertical load
line_2 = Line(line)
len = Length(Curve=line_2)
num = Number(support_conditions)
num_2 = Number(strength_class_wood)
num_3 = Number(load)
multiplication = Multiplication(A=num, B=len)
expression = Expression(Ncr=num_3, E=num_2, ls=multiplication, Expression="(ls^2*Ncr)/(Pi^2*E)")
num_4 = Number(expression)
momen_of_inertia = ClusterOutput(num_4)  # Moment of inertia needed to take the given load

# ==== cluster BeregningAfInertimomentMedKomponenter
num = ClusterInput()
num_2 = ClusterInput()
line = ClusterInput()
num_3 = ClusterInput()
num_4 = Number(num)
num_5 = Number(num_2)
line_2 = Line(line)
num_6 = Number(num_3)
pi = Pi(Factor=1)
len = Length(Curve=line_2)
sqr = Square(Value=pi)
multiplication = Multiplication(A=num_6, B=len)
multiplication_2 = Multiplication(A=num_5, B=sqr)
sqr_2 = Square(Value=multiplication)
multiplication_3 = Multiplication(A=num_4, B=sqr_2)
division = Division(A=multiplication_3, B=multiplication_2)
num_7 = Number(division)
num_8 = ClusterOutput(num_7)
